# Grasshopper definition 1-5Single Curved Algorithm.gh (Grasshopper 1.0.7)

surface = Surface(<surface referenced from the Rhino model>)

surface_2 = Surface([<surface referenced from the Rhino model> x480])
surface_3 = Surface(<surface referenced from the Rhino model>)
surface_4 = Surface(<surface referenced from the Rhino model>)
graft_tree = GraftTree(Tree=surface_2, IncludeEmptyLists=True, IncludeNullItems=True)
deconstruct_brep = DeconstructBrep(Brep=graft_tree)  # -> Faces, Edges, Vertices
length = Length(Curve=deconstruct_brep.Edges)
sort_list = SortList(Keys=length, ValuesValuesA=deconstruct_brep.Edges)  # -> Keys, reverse(ValuesValuesA)
list_item = ListItem(List=sort_list.ValuesValuesA, Index=Slider(1, range=0..10), Wrap=True)
list_item_2 = ListItem(List=sort_list.ValuesValuesA, Index=Slider(0, range=0..1), Wrap=True)
curve = Curve(<curve referenced from the Rhino model>)
curve_2 = Curve(<curve referenced from the Rhino model>)
length_2 = Length(Curve=sort_list.ValuesValuesA)
area = Area(Geometry=graft_tree)  # -> Area, Centroid
curve_middle = CurveMiddle(Curve=list_item_2)
curve_middle_2 = CurveMiddle(Curve=list_item)
panel = Panel(length_2)
panel_2 = Panel(length)
line = Line(StartPoint=curve_middle, EndPoint=curve_middle_2)
curve_middle_3 = CurveMiddle(Curve=line)
surface_closest_point = SurfaceClosestPoint(Point=curve_middle_3, Surface=graft_tree)  # -> Point, UVPoint, Distance
circle_3pt = Circle3Pt(PointA=curve_middle, PointB=surface_closest_point.Point, PointC=curve_middle_2)  # -> Circle, Plane, Radius
boundary_surfaces = BoundarySurfaces(Edges=circle_3pt.Circle)
area_2 = Area(Geometry=boundary_surfaces)  # -> Area, Centroid
evaluate_surface = EvaluateSurface(Surface=boundary_surfaces, Point=area_2.Centroid)  # -> Point, Normal, UDirection, VDirection, Frame
number_slider = Slider(10, range=0..10)
multiplication = Multiplication(A=evaluate_surface.Normal, B=number_slider)
extrude = Extrude(Base=circle_3pt.Circle, Direction=multiplication)
multiplication_2 = Multiplication(A=number_slider, B=Slider(0.5, range=0..1))
multiplication_3 = Multiplication(A=evaluate_surface.Normal, B=multiplication_2)
negative = Negative(Value=multiplication_3)
move = Move(Geometry=extrude, Motion=negative)  # -> Geometry, Transform
deconstruct_brep_2 = DeconstructBrep(Brep=graft_tree)  # -> Faces, Edges, Vertices
point = Point(surface_closest_point.Point)
area_3 = Area(Geometry=boundary_surfaces)  # -> Area, Centroid
join_curves = JoinCurves(Curves=deconstruct_brep_2.Edges, Preserve=False)
curve_3 = Curve(join_curves)
line_2 = Line(StartPoint=point, EndPoint=area_3.Centroid)
project = Project(Curve=curve_3, Brep=move.Geometry, Direction=line_2)
list_item_3 = ListItem(List=project, Index=Slider(1, range=0..1), Wrap=True)
list_item_4 = ListItem(List=project, Index=0, Wrap=True)
curve_middle_4 = CurveMiddle(Curve=list_item_4)
curve_middle_5 = CurveMiddle(Curve=list_item_3)
surface_closest_point_2 = SurfaceClosestPoint(Point=curve_middle_4, Surface=surface_4)  # -> Point, UVPoint, Distance
surface_closest_point_3 = SurfaceClosestPoint(Point=curve_middle_5, Surface=surface_4)  # -> Point, UVPoint, Distance
point_2 = Point(surface_closest_point_3.Point)
point_3 = Point(surface_closest_point_2.Point)
distance = Distance(PointA=curve_middle_4, PointB=point_3)
distance_2 = Distance(PointA=curve_middle_5, PointB=point_2)
smaller_than = SmallerThan(FirstNumber=distance, SecondNumber=distance_2)  # -> SmallerThan, OrEqualTo
param_viewer = ParamViewer(smaller_than.SmallerThan)
ghpython_script = GhPythonScript(x=flatten(list_item_4), y=flatten(list_item_3), z=flatten(smaller_than.SmallerThan))  # -> out, graft(a); inputs x: list of Curve, y: list of Curve, z: list of Boolean
# ---------- ghpython_script: Python ----------
__author__ = "xkool"
__version__ = "2021.11.05"

import rhinoscriptsyntax as rs
crv = []
print(type(x))
print z
for i in range(len(x)):
    if z[i] is True:
        crv.append(x[i])
    else:
        crv.append(y[i])
a = crv
# ---------- end ghpython_script ----------
curve_4 = Curve(ghpython_script.a)
discontinuity = Discontinuity(Curve=curve_4, Level=1)  # -> Points, Parameters
shatter = Shatter(Curve=curve_4, Parameters=discontinuity.Parameters)
list_item_5 = ListItem(List=shatter, Index=0, Wrap=True)
list_item_6 = ListItem(List=shatter, Index=Slider(1, range=0..1), Wrap=True)
list_item_7 = ListItem(List=shatter, Index=Slider(2, range=0..10), Wrap=True)
list_item_8 = ListItem(List=shatter, Index=Slider(3, range=0..10), Wrap=True)
edge_surface = EdgeSurface(CurveA=list_item_5, CurveB=list_item_6, CurveC=list_item_7, CurveD=list_item_8)
surface_5 = Surface(flatten(edge_surface))

surface_6 = Surface(<surface referenced from the Rhino model>)
graft_tree_2 = GraftTree(Tree=surface, IncludeEmptyLists=True, IncludeNullItems=True)
custom_preview = CustomPreview(Geometry=surface, Material=ColourSwatch(SwatchColor=RGBA(255, 255, 255, 75)))  # disabled
deconstruct_brep_3 = DeconstructBrep(Brep=graft_tree_2)  # -> Faces, Edges, Vertices
mesh_surface = MeshSurface(UCount=5, VCount=5, Overhang=True, Equalize=False)
length_3 = Length(Curve=deconstruct_brep_3.Edges)
sort_list_2 = SortList(Keys=length_3, ValuesValuesA=deconstruct_brep_3.Edges)  # -> Keys, reverse(ValuesValuesA)
list_item_9 = ListItem(List=sort_list_2.ValuesValuesA, Index=Slider(1, range=0..10), Wrap=True)
list_item_10 = ListItem(List=sort_list_2.ValuesValuesA, Index=Slider(0, range=0..1), Wrap=True)
length_4 = Length(Curve=sort_list_2.ValuesValuesA)
area_4 = Area(Geometry=graft_tree_2)  # -> Area, Centroid
curve_middle_6 = CurveMiddle(Curve=list_item_10)
curve_middle_7 = CurveMiddle(Curve=list_item_9)
surface_7 = Surface(graft(surface_5))
panel_3 = Panel(length_4)
panel_4 = Panel(length_3)
line_3 = Line(StartPoint=curve_middle_6, EndPoint=curve_middle_7)
curve_middle_8 = CurveMiddle(Curve=line_3)
area_5 = Area(Geometry=surface_7)  # -> Area, Centroid
surface_closest_point_4 = SurfaceClosestPoint(Point=curve_middle_8, Surface=graft_tree_2)  # -> Point, UVPoint, Distance
deconstruct_brep_4 = DeconstructBrep(Brep=surface_7)  # -> Faces, Edges, Vertices
circle_3pt_2 = Circle3Pt(PointA=curve_middle_6, PointB=surface_closest_point_4.Point, PointC=curve_middle_7)  # -> Circle, Plane, Radius
vector_2pt = Vector2Pt(PointA=area_5.Centroid, PointB=deconstruct_brep_4.Vertices, Unitize=False)  # -> Vector, Length
boundary_surfaces_2 = BoundarySurfaces(Edges=circle_3pt_2.Circle)
data = Data(flatten(circle_3pt.Radius))
panel_5 = Panel(data)
area_6 = Area(Geometry=boundary_surfaces_2)  # -> Area, Centroid
ghpython_script_2 = GhPythonScript(x=data)  # -> a; inputs x: list
# ---------- ghpython_script_2: Python ----------
__author__ = "xkool"
__version__ = "2021.11.08"

import rhinoscriptsyntax as rs
a = []
for i in x:
    if i > 20:
        a.append(20)
    else:
        a.append(i)
# ---------- end ghpython_script_2 ----------
bounds = Bounds(Numbers=ghpython_script_2)
simplify_tree = SimplifyTree(Tree=vector_2pt.Length, Front=False)
param_viewer_2 = ParamViewer(vector_2pt.Length)
evaluate_surface_2 = EvaluateSurface(Surface=boundary_surfaces_2, Point=area_6.Centroid)  # -> Point, Normal, UDirection, VDirection, Frame
panel_6 = Panel(vector_2pt.Length)
number_slider_2 = Slider(10, range=0..10)
remap_numbers = RemapNumbers(Value=ghpython_script_2, Source=bounds, Target="1.5 to 2")  # -> graft(Mapped), Clipped
merge = Merge(Data1=simplify(vector_2pt.Length), Data2=simplify(remap_numbers.Mapped))
multiplication_4 = Multiplication(A=evaluate_surface_2.Normal, B=number_slider_2)
bounds_2 = Bounds(Numbers=remap_numbers.Mapped)
extrude_2 = Extrude(Base=circle_3pt_2.Circle, Direction=multiplication_4)
multiplication_5 = Multiplication(A=number_slider_2, B=Slider(0.5, range=0..1))
panel_7 = Panel(remap_numbers.Mapped)
multiplication_6 = Multiplication(A=evaluate_surface_2.Normal, B=multiplication_5)
panel_8 = Panel(merge)
negative_2 = Negative(Value=multiplication_6)
move_2 = Move(Geometry=extrude_2, Motion=negative_2)  # -> Geometry, Transform
param_viewer_3 = ParamViewer(remap_numbers.Mapped)
deconstruct_brep_5 = DeconstructBrep(Brep=graft_tree_2)  # -> Faces, Edges, Vertices
point_4 = Point(surface_closest_point_4.Point)
area_7 = Area(Geometry=boundary_surfaces_2)  # -> Area, Centroid
join_curves_2 = JoinCurves(Curves=deconstruct_brep_5.Edges, Preserve=False)
curve_5 = Curve(join_curves_2)
line_4 = Line(StartPoint=point_4, EndPoint=area_7.Centroid)
project_2 = Project(Curve=curve_5, Brep=move_2.Geometry, Direction=line_4)
list_item_11 = ListItem(List=project_2, Index=Slider(1, range=0..1), Wrap=True)
list_item_12 = ListItem(List=project_2, Index=0, Wrap=True)
curve_middle_9 = CurveMiddle(Curve=list_item_12)
curve_middle_10 = CurveMiddle(Curve=list_item_11)
surface_closest_point_5 = SurfaceClosestPoint(Point=curve_middle_9, Surface=surface_6)  # -> Point, UVPoint, Distance
surface_closest_point_6 = SurfaceClosestPoint(Point=curve_middle_10, Surface=surface_6)  # -> Point, UVPoint, Distance
point_5 = Point(surface_closest_point_6.Point)
point_6 = Point(surface_closest_point_5.Point)
distance_3 = Distance(PointA=curve_middle_9, PointB=point_6)
distance_4 = Distance(PointA=curve_middle_10, PointB=point_5)
smaller_than_2 = SmallerThan(FirstNumber=distance_3, SecondNumber=distance_4)  # -> SmallerThan, OrEqualTo
param_viewer_4 = ParamViewer(smaller_than_2.SmallerThan)
ghpython_script_3 = GhPythonScript(x=flatten(list_item_12), y=flatten(list_item_11), z=flatten(smaller_than_2.SmallerThan))  # -> out, graft(a); inputs x: list of Curve, y: list of Curve, z: list of Boolean; same code as ghpython_script
curve_6 = Curve(ghpython_script_3.a)
discontinuity_2 = Discontinuity(Curve=curve_6, Level=1)  # -> Points, Parameters
shatter_2 = Shatter(Curve=curve_6, Parameters=discontinuity_2.Parameters)
list_item_13 = ListItem(List=shatter_2, Index=0, Wrap=True)
list_item_14 = ListItem(List=shatter_2, Index=Slider(1, range=0..1), Wrap=True)
list_item_15 = ListItem(List=shatter_2, Index=Slider(2, range=0..10), Wrap=True)
list_item_16 = ListItem(List=shatter_2, Index=Slider(3, range=0..10), Wrap=True)
edge_surface_2 = EdgeSurface(CurveA=list_item_13, CurveB=list_item_14, CurveC=list_item_15, CurveD=list_item_16)
surface_8 = Surface(flatten(edge_surface_2))
curve_7 = Curve(<curve referenced from the Rhino model>)
curve_8 = Curve(<curve referenced from the Rhino model>)
curve_9 = Curve(<curve referenced from the Rhino model>)
number_slider_3 = Slider(40, range=0..100)
number_slider_4 = Slider(15, range=0..100)
loft = Loft(
    Curves=[curve_7, curve_8, curve_9],
    Options={Adjust=False, Closed=False, LoftEnds=0, LoftSimp=0, LoftType=0, Rebuild=10, Refit=0.01})
surface_9 = Surface(surface_5)
custom_preview_2 = CustomPreview(Geometry=surface_8, Material=ColourSwatch(SwatchColor=RGBA(105, 225, 255, 182)))
mesh_surface_2 = MeshSurface(Surface=loft, UCount=number_slider_4, VCount=number_slider_3, Overhang=True, Equalize=False)
number_slider_5 = Slider(8, range=0..10)
number_slider_6 = Slider(60, range=0..100)
mesh_edges = MeshEdges(Mesh=mesh_surface_2)  # -> NakedEdges, InteriorEdges, NonManifoldEdges
number_slider_7 = Slider(10, range=0..10)
number_slider_8 = Slider(5, range=0..10)
surface_10 = Surface(<surface referenced from the Rhino model>)
surface_11 = Surface(<surface referenced from the Rhino model>)
curve_10 = Curve([mesh_edges.InteriorEdges, mesh_edges.NakedEdges])
surface_split = SurfaceSplit(Surface=loft, Curves=curve_10)
mesh_surface_3 = MeshSurface(Surface=surface_11, UCount=number_slider_5, VCount=number_slider_6, Overhang=True, Equalize=False)
mesh_surface_4 = MeshSurface(Surface=surface_10, UCount=number_slider_8, VCount=number_slider_7, Overhang=True, Equalize=False)
area_8 = Area(Geometry=surface_split)  # -> Area, Centroid
mesh_edges_2 = MeshEdges(Mesh=mesh_surface_4)  # -> NakedEdges, InteriorEdges, NonManifoldEdges
curve_11 = Curve([<curve referenced from the Rhino model> x16])
mesh_edges_3 = MeshEdges(Mesh=mesh_surface_3)  # -> NakedEdges, InteriorEdges, NonManifoldEdges
smaller_than_3 = SmallerThan(FirstNumber=area_8.Area, SecondNumber=Slider(1, range=0..1))  # -> SmallerThan, OrEqualTo
surface_split_2 = SurfaceSplit(Surface=surface_10, Curves=mesh_edges_2.InteriorEdges)
merge_2 = Merge(Data1=curve_11, Data2=mesh_edges_3.InteriorEdges)  # -> flatten(Result)
dispatch = Dispatch(List=surface_split, DispatchPattern=smaller_than_3.SmallerThan)  # -> ListA, ListB
surface_split_3 = SurfaceSplit(Surface=surface_11, Curves=merge_2)
curve_12 = Curve(mesh_edges_3.NakedEdges)
number_slider_9 = Slider(0, range=0..100)
list_item_17 = ListItem(List=mesh_edges_3.NakedEdges, Index=0, Wrap=True)
surface_12 = Surface(dispatch.ListB)

surface_13 = Surface(surface_12)
surface_14 = Surface(loft)
graft_tree_3 = GraftTree(Tree=surface_13, IncludeEmptyLists=True, IncludeNullItems=True)
deconstruct_brep_6 = DeconstructBrep(Brep=graft_tree_3)  # -> Faces, Edges, Vertices
length_5 = Length(Curve=deconstruct_brep_6.Edges)
sort_list_3 = SortList(Keys=length_5, ValuesValuesA=deconstruct_brep_6.Edges)  # -> Keys, reverse(ValuesValuesA)
list_item_18 = ListItem(List=sort_list_3.ValuesValuesA, Index=Slider(1, range=0..10), Wrap=True)
list_item_19 = ListItem(List=sort_list_3.ValuesValuesA, Index=Slider(0, range=0..1), Wrap=True)
curve_13 = Curve(<curve referenced from the Rhino model>)
curve_14 = Curve(<curve referenced from the Rhino model>)
length_6 = Length(Curve=sort_list_3.ValuesValuesA)
area_9 = Area(Geometry=graft_tree_3)  # -> Area, Centroid
curve_middle_11 = CurveMiddle(Curve=list_item_19)
curve_middle_12 = CurveMiddle(Curve=list_item_18)
panel_9 = Panel(length_6)
panel_10 = Panel(length_5)
line_5 = Line(StartPoint=curve_middle_11, EndPoint=curve_middle_12)
curve_middle_13 = CurveMiddle(Curve=line_5)
surface_closest_point_7 = SurfaceClosestPoint(Point=curve_middle_13, Surface=graft_tree_3)  # -> Point, UVPoint, Distance
circle_3pt_3 = Circle3Pt(PointA=curve_middle_11, PointB=surface_closest_point_7.Point, PointC=curve_middle_12)  # -> Circle, Plane, Radius
boundary_surfaces_3 = BoundarySurfaces(Edges=circle_3pt_3.Circle)
area_10 = Area(Geometry=boundary_surfaces_3)  # -> Area, Centroid
evaluate_surface_3 = EvaluateSurface(Surface=boundary_surfaces_3, Point=area_10.Centroid)  # -> Point, Normal, UDirection, VDirection, Frame
number_slider_10 = Slider(10, range=0..10)
multiplication_7 = Multiplication(A=evaluate_surface_3.Normal, B=number_slider_10)
extrude_3 = Extrude(Base=circle_3pt_3.Circle, Direction=multiplication_7)
multiplication_8 = Multiplication(A=number_slider_10, B=Slider(0.5, range=0..1))
multiplication_9 = Multiplication(A=evaluate_surface_3.Normal, B=multiplication_8)
negative_3 = Negative(Value=multiplication_9)
move_3 = Move(Geometry=extrude_3, Motion=negative_3)  # -> Geometry, Transform
deconstruct_brep_7 = DeconstructBrep(Brep=graft_tree_3)  # -> Faces, Edges, Vertices
point_7 = Point(surface_closest_point_7.Point)
area_11 = Area(Geometry=boundary_surfaces_3)  # -> Area, Centroid
join_curves_3 = JoinCurves(Curves=deconstruct_brep_7.Edges, Preserve=False)
curve_15 = Curve(join_curves_3)
line_6 = Line(StartPoint=point_7, EndPoint=area_11.Centroid)
project_3 = Project(Curve=curve_15, Brep=move_3.Geometry, Direction=line_6)
list_item_20 = ListItem(List=project_3, Index=Slider(1, range=0..1), Wrap=True)
list_item_21 = ListItem(List=project_3, Index=0, Wrap=True)
curve_middle_14 = CurveMiddle(Curve=list_item_21)
curve_middle_15 = CurveMiddle(Curve=list_item_20)
surface_closest_point_8 = SurfaceClosestPoint(Point=curve_middle_14, Surface=surface_14)  # -> Point, UVPoint, Distance
surface_closest_point_9 = SurfaceClosestPoint(Point=curve_middle_15, Surface=surface_14)  # -> Point, UVPoint, Distance
point_8 = Point(surface_closest_point_9.Point)
point_9 = Point(surface_closest_point_8.Point)
distance_5 = Distance(PointA=curve_middle_14, PointB=point_9)
distance_6 = Distance(PointA=curve_middle_15, PointB=point_8)
smaller_than_4 = SmallerThan(FirstNumber=distance_5, SecondNumber=distance_6)  # -> SmallerThan, OrEqualTo
param_viewer_5 = ParamViewer(smaller_than_4.SmallerThan)
ghpython_script_4 = GhPythonScript(x=flatten(list_item_21), y=flatten(list_item_20), z=flatten(smaller_than_4.SmallerThan))  # -> out, graft(a); inputs x: list of Curve, y: list of Curve, z: list of Boolean; same code as ghpython_script
curve_16 = Curve(ghpython_script_4.a)
discontinuity_3 = Discontinuity(Curve=curve_16, Level=1)  # -> Points, Parameters
shatter_3 = Shatter(Curve=curve_16, Parameters=discontinuity_3.Parameters)
list_item_22 = ListItem(List=shatter_3, Index=0, Wrap=True)
list_item_23 = ListItem(List=shatter_3, Index=Slider(1, range=0..1), Wrap=True)
list_item_24 = ListItem(List=shatter_3, Index=Slider(2, range=0..10), Wrap=True)
list_item_25 = ListItem(List=shatter_3, Index=Slider(3, range=0..10), Wrap=True)
edge_surface_3 = EdgeSurface(CurveA=list_item_22, CurveB=list_item_23, CurveC=list_item_24, CurveD=list_item_25)
surface_15 = Surface(flatten(edge_surface_3))
surface_16 = Surface(surface_15)

surface_17 = Surface([<surface referenced from the Rhino model> x50])
surface_18 = Surface(surface_split_2)
file_path = FilePath("C:\Users\xkool\Desktop\复杂曲面表皮研究\Jankin_Solution\Divergence.py")

# ---- group: 双曲
surface_19 = Surface(surface_12)

# ---- group: 平板
surface_20 = Surface([<surface referenced from the Rhino model> x600])

# ---- group: 单曲
surface_21 = Surface(surface_16)

# ----
param_viewer_6 = ParamViewer(surface_split_3)
read_file = ReadFile(File=file_path, PerLineParse=False)
surface_22 = Surface(surface_split_3)
surface_23 = Surface([<surface referenced from the Rhino model> x480])
number_slider_11 = Slider(0, range=0..1000)
list_item_26 = ListItem(List=surface_18, Index=number_slider_9, Wrap=True)
list_item_27 = ListItem(List=surface_17, Index=number_slider_9, Wrap=True)
number_slider_12 = Slider(0, range=0..1000)
ghpython_script_5 = GhPythonScript(
    Code=read_file,
    TrueSurface=surface_19,
    SingleSurface=surface_21,
    Surfaces=surface_20,
    U=number_slider_4,
    V=number_slider_3,
    DivergenceThershold=Slider(0.006, range=0..0.1))  # -> Out, A, B, C, D, E
panel_11 = Panel(ghpython_script_5.E)
ghpython_script_6 = GhPythonScript(
    Code=read_file,
    TrueSurface=surface_18,
    Surfaces=surface_17,
    U=number_slider_8,
    V=number_slider_7,
    DivergenceThershold=Slider(0.002, range=0..0.1))  # -> Out, A, B, C, D
list_item_28 = ListItem(List=surface_19, Index=number_slider_11, Wrap=True)
list_item_29 = ListItem(List=surface_20, Index=number_slider_11, Wrap=True)
list_item_30 = ListItem(List=surface_21, Index=number_slider_11, Wrap=True)
ghpython_script_7 = GhPythonScript(
    Code=read_file,
    TrueSurface=surface_22,
    SingleSurface=surface_9,
    Surfaces=surface_23,
    U=number_slider_5,
    V=number_slider_6,
    DivergenceThershold=Slider(0.004, range=0..0.1))  # -> Out, A, B, C, D, E
surface_24 = Surface(ghpython_script_5.C)
surface_25 = Surface(ghpython_script_5.D)
surface_26 = Surface(ghpython_script_5.E)

# ---- group: 双曲
list_item_31 = ListItem(List=surface_22, Index=number_slider_12, Wrap=True)

# ---- group: 单曲
list_item_32 = ListItem(List=surface_9, Index=number_slider_12, Wrap=True)

# ---- group: 平板
list_item_33 = ListItem(List=surface_23, Index=number_slider_12, Wrap=True)

# ----
panel_12 = Panel(ghpython_script_7.E)
custom_preview_3 = CustomPreview(Geometry=surface_26, Material=ColourSwatch(SwatchColor=RGBA(255, 205, 97, 75)))
surface_27 = Surface(ghpython_script_6.C)
custom_preview_4 = CustomPreview(Geometry=surface_25, Material=ColourSwatch(SwatchColor=RGBA(97, 213, 255, 75)))
surface_28 = Surface(ghpython_script_6.D)
custom_preview_5 = CustomPreview(Geometry=surface_24, Material=ColourSwatch(SwatchColor=RGBA(255, 255, 255, 108)))
surface_29 = Surface(ghpython_script_7.C)
surface_30 = Surface(ghpython_script_7.D)
surface_31 = Surface(ghpython_script_7.E)
custom_preview_6 = CustomPreview(Geometry=surface_27, Material=ColourSwatch(SwatchColor=RGBA(255, 255, 255, 108)))
custom_preview_7 = CustomPreview(Geometry=surface_28, Material=ColourSwatch(SwatchColor=RGBA(97, 213, 255, 75)))
panel_13 = Panel(ghpython_script_6.C)
custom_preview_8 = CustomPreview(Geometry=surface_31, Material=ColourSwatch(SwatchColor=RGBA(255, 205, 97, 75)))
custom_preview_9 = CustomPreview(Geometry=surface_30, Material=ColourSwatch(SwatchColor=RGBA(97, 213, 255, 75)))
custom_preview_10 = CustomPreview(Geometry=surface_29, Material=ColourSwatch(SwatchColor=RGBA(186, 186, 186, 108)))
