# Grasshopper definition 2-1k-means colored.gh (Grasshopper 1.0.7)

surface = Surface([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])
ghpython_script = GhPythonScript(srf=surface)  # -> UnrollSrf; inputs srf: list of Brep
# ---------- ghpython_script: Python ----------
__author__ = "xkool"
__version__ = "2021.11.10"

import rhinoscriptsyntax as rs
import Rhino.Geometry as rg

UnrollSrf = []
for i in range(len(srf)):
    surface_id = srf[i]
    #print(type(surface_id))
    unroll_srf = rs.UnrollSurface(surface_id)
    #print(unroll_srf)
    #print(type(unroll_srf))
    UnrollSrf.append(unroll_srf[0])

print(len(UnrollSrf))
# ---------- end ghpython_script ----------
deconstruct_brep = DeconstructBrep(Brep=surface)  # -> Faces, Edges, Vertices
area = Area(Geometry=surface)  # -> Area, graft(Centroid)
surface_2 = Surface(ghpython_script)
read_file = ReadFile(File="C:\Users\xkool\Downloads\cluster_Lenght_Angle.csv", PerLineParse=True)
area_2 = Area(Geometry=surface_2)  # -> Area, graft(Centroid)
deconstruct_brep_2 = DeconstructBrep(Brep=surface_2)  # -> Faces, Edges, Vertices
vector_2pt = Vector2Pt(PointA=area.Centroid, PointB=deconstruct_brep.Vertices, Unitize=False)  # -> Vector, Length
construct_point = ConstructPoint(XCoordinate=0, YCoordinate=0, ZCoordinate=0)
ghpython_script_2 = GhPythonScript(y=surface, x=read_file)  # -> a, b, c, d, e, f, g, h; inputs y: list, x: list of Int32
# ---------- ghpython_script_2: Python ----------
__author__ = "xkool"
__version__ = "2021.11.09"

import rhinoscriptsyntax as rs
a = []
b = []
c = []
d = []
e = []
f = []
g = []
h = []
for i in range(len(x)):
    index = x[i]
    if index == 0:
        a.append(y[i])
    elif index == 1:
        b.append(y[i]) 
    elif index == 2:
        c.append(y[i])
    elif index == 3:
        d.append(y[i]) 
    elif index == 4:
        e.append(y[i])
    elif index == 5:
        f.append(y[i])
    elif index == 6:
        g.append(y[i]) 
    elif index == 7:
        h.append(y[i])
# ---------- end ghpython_script_2 ----------
surface_3 = Surface(ghpython_script_2.d)
surface_4 = Surface(ghpython_script_2.e)
surface_5 = Surface(ghpython_script_2.a)
surface_6 = Surface(ghpython_script_2.b)
surface_7 = Surface(ghpython_script_2.c)
surface_8 = Surface(ghpython_script_2.f)
surface_9 = Surface(ghpython_script_2.g)
surface_10 = Surface(ghpython_script_2.h)
vector_2pt_2 = Vector2Pt(PointA=area_2.Centroid, PointB=deconstruct_brep_2.Vertices, Unitize=False)  # -> Vector, Length
vector_2pt_3 = Vector2Pt(PointA=area_2.Centroid, PointB=deconstruct_brep_2.Vertices, Unitize=False)  # -> Vector, Length
param_viewer = ParamViewer(vector_2pt.Vector)
graft_tree = GraftTree(Tree=surface_2, IncludeEmptyLists=True, IncludeNullItems=True)
vector_2pt_4 = Vector2Pt(PointA=area_2.Centroid, PointB=construct_point, Unitize=False)  # -> Vector, Length
list_item = ListItem(List=vector_2pt.Vector, Index=0, Wrap=True)
list_item_2 = ListItem(List=vector_2pt.Vector, Index=Slider(1, range=0..1), Wrap=True)
move = Move(Geometry=graft_tree, Motion=vector_2pt_4.Vector)  # -> Geometry, Transform
sort_list = SortList(Keys=vector_2pt_2.Length, ValuesValuesA=vector_2pt_2.Vector)  # -> Keys, reverse(ValuesValuesA)
custom_preview = CustomPreview(Geometry=surface_5, Material=ColourSwatch(SwatchColor=RGBA(199, 199, 199, 155)))
custom_preview_2 = CustomPreview(Geometry=surface_6, Material=ColourSwatch(SwatchColor=RGBA(255, 125, 125, 155)))
custom_preview_3 = CustomPreview(Geometry=surface_7, Material=ColourSwatch(SwatchColor=RGBA(253, 255, 148, 155)))
custom_preview_4 = CustomPreview(Geometry=surface_3, Material=ColourSwatch(SwatchColor=RGBA(86, 176, 77, 155)))
custom_preview_5 = CustomPreview(Geometry=surface_4, Material=ColourSwatch(SwatchColor=RGBA(87, 182, 217, 155)))
custom_preview_6 = CustomPreview(Geometry=surface_8, Material=ColourSwatch(SwatchColor=RGBA(173, 148, 255, 155)))
custom_preview_7 = CustomPreview(Geometry=surface_9, Material=ColourSwatch(SwatchColor=RGBA(255, 196, 125, 155)))
custom_preview_8 = CustomPreview(Geometry=surface_10, Material=ColourSwatch(SwatchColor=RGBA(120, 241, 255, 155)))
panel = Panel(list_item)
panel_2 = Panel(list_item_2)
custom_preview_9 = CustomPreview(Geometry=move.Geometry, Material=ColourSwatch(SwatchColor=RGB(156, 156, 156)))
number_slider = Slider(0, range=0..100)
vector_length = VectorLength(Vector=sort_list.ValuesValuesA)
multiplication = Multiplication(A=list_item, B=list_item_2)
param_viewer_2 = ParamViewer(move.Geometry)
data = Data(multiplication)
angle = Angle()  # -> Angle, Reflex
panel_3 = Panel(vector_2pt_2.Length)
flatten_tree = FlattenTree(Tree=data, Path="{0}")
bounds = Bounds(Numbers=flatten_tree)
panel_4 = Panel(vector_2pt.Length)
panel_5 = Panel(bounds)
panel_6 = Panel(vector_length)
remap_numbers = RemapNumbers(Value=flatten_tree, Source=bounds, Target="1 to 2")  # -> graft(Mapped), Clipped
panel_7 = Panel(vector_2pt.Length)
bounds_2 = Bounds(Numbers=panel_7)
panel_8 = Panel(bounds_2)
panel_9 = Panel(remap_numbers.Mapped)
merge = Merge(Data1=vector_2pt.Length, Data2=remap_numbers.Mapped)
panel_10 = Panel(merge)
